# Grasshopper definition example.ghx (Grasshopper 1.0.7)
# plug-ins: Speckle 2, LunchBox

# ---- group: RH_IN:Link
txt = Text()

# ----
sr = SynchronousReceiver(
    Stream=txt,
    AutoReceive=False,
    KitName="Objects",
    ReceivedObjectId="66cc5e51b865617294e12ca6409e9a4a",
    StreamWrapper="https://macad.speckle.xyz/streams/8fc4c25306",
    selectedKitName="Objects")  # -> Data, Info
sovk = SpeckleObjectValueByKey(Object=sr.Data, Key="Walls", selectedKitName="Objects")
sovk_2 = SpeckleObjectValueByKey(Object=sovk, Key="parameters", selectedKitName="Objects")

sovk_3 = SpeckleObjectValueByKey(Object=sovk_2, Key="faae278b-7fcd-4840-9d5c-fcd1cb2c4068", selectedKitName="Objects")
sovk_4 = SpeckleObjectValueByKey(Object=sovk_3, Key="name", selectedKitName="Objects")
sovk_5 = SpeckleObjectValueByKey(Object=sovk_3, Key="value", selectedKitName="Objects")
panel = Panel(sovk_5)
panel_2 = Panel(sovk_4)

sovk_6 = SpeckleObjectValueByKey(Object=sovk_2, Key="87c493a7-09c4-42fb-8bfb-c683efe1bbf7", selectedKitName="Objects")
sovk_7 = SpeckleObjectValueByKey(Object=sovk_6, Key="name", selectedKitName="Objects")
sovk_8 = SpeckleObjectValueByKey(Object=sovk_6, Key="value", selectedKitName="Objects")
panel_3 = Panel(sovk_8)
panel_4 = Panel(sovk_7)

sovk_9 = SpeckleObjectValueByKey(Object=sovk, Key="displayValue", selectedKitName="Objects")
bbox = BoundingBox(Content=sovk_9, Plane=PlaneXY(0, 0, 0))  # -> Box, Box_2
debrep = DeconstructBrep(Brep=bbox.Box_2)  # -> Faces, Edges, Vertices
item = ListItem(List=debrep.Faces, Index=0, Wrap=True)
trib = TrianglePanelsB(Surface=item, UDivisions=panel_3, VDivisions=panel)
area = Area(Geometry=trib)  # -> Area, Centroid
scale = Scale(Geometry=trib, Center=area.Centroid, Factor=Slider(0.9, range=0..1))  # -> Geometry, Transform

sgetwt = StreamGetWithToken(Stream="https://macad.speckle.xyz/streams/3890da3592", AuthToken="eb53b06b9cb00fba85f0b17377e8a7120f22931b7a")

lng = ListLength(List=scale.Geometry)
random = Random(Range="0 to 100", Number=lng, Seed=2)
panel_5 = Panel("Receive_From_Compute Stream")
panel_6 = Panel("Bot Speckle Token")
cso = CreateSpeckleObject(Panels=scale.Geometry, Fake_Cost=random, selectedKitName="Objects")

# ---- group: RH_OUT:Cost
num = Number(random)

# ----
ss = SynchronousSender(
    Data=cso,
    Stream=sgetwt,
    OutputWrappers="https://macad.speckle.xyz\tf82bf82296\tedc778bca7",
    UseDefaultCache=True,
    selectedKitName="Objects")
